# Grasshopper definition 220117_Towers MP.gh (Grasshopper 1.0.7)
# plug-ins: treesloth01, EleFront

panel = Panel("""5
10
15
8""")
geo = Geometry([<point referenced from the Rhino model> x4])
panel_2 = Panel("40")
panel_3 = Panel("""0
1.5
3""")
panel_4 = Panel("""20
5
10""")
panel_5 = Panel("""3
4.5
6""")
panel_6 = Panel("""3.5
4.5
3""")
panel_7 = Panel("""1
2
3""")
base_points = GetGeometry(AtLeast=1, AtMost=2147483647, DeleteInput=False, Filter=1073741825, Prompt="Choose basepoints for towers")
base_side_length = GetInteger(AtLeast=1, AtMost=2147483647, Maximum=2147483647, Minimum=-2147483648, Prompt="Choose square ground floor dimensions")
fillet_radius = GetNumber(
    AtLeast=1,
    AtMost=2147483647,
    Maximum=1.797693135e+308,
    Minimum=-1.797693135e+308,
    Prompt="Do you want to fillet the corners? Choose radii")
terrace_width = GetNumber(
    AtLeast=1,
    AtMost=2147483647,
    Maximum=1.797693135e+308,
    Minimum=-1.797693135e+308,
    Prompt="How wide do you want the terraces? Multiple widths for multiple towers")
gf_height = GetNumber(AtLeast=1, AtMost=2147483647, Maximum=1.797693135e+308, Minimum=-1.797693135e+308, Prompt="Choose ground floor heights")
floor_height = GetNumber(
    AtLeast=1,
    AtMost=2147483647,
    Maximum=1.797693135e+308,
    Minimum=-1.797693135e+308,
    Prompt="Choose floor to floor heights")
n_floors = GetInteger(AtLeast=1, AtMost=2147483647, Maximum=2147483647, Minimum=-2147483648, Prompt="Choose number of floors")
glass_size = GetNumber(AtLeast=1, AtMost=2147483647, Maximum=1.797693135e+308, Minimum=-1.797693135e+308, Prompt="Choose glass size")
lng = ListLength(List=base_points)
split = SplitList(List=base_side_length, Index=lng)  # -> ListA, ListB
division = Division(A=split.ListA, B=2)
neg = Negative(Value=division)
dom = ConstructDomain(DomainStart=neg, DomainEnd=division)
rectangle = Rectangle(Plane=base_points, XSize=dom, YSize=dom, Radius=0)  # -> Rectangle, Length
runion = RegionUnion(Curves=rectangle.Rectangle)
lng_2 = ListLength(List=runion)
split_2 = SplitList(List=fillet_radius, Index=lng_2)  # -> ListA, ListB
split_3 = SplitList(List=terrace_width, Index=lng_2)  # -> ListA, ListB
split_4 = SplitList(List=gf_height, Index=lng_2)  # -> ListA, ListB
split_5 = SplitList(List=floor_height, Index=lng_2)  # -> ListA, ListB
split_6 = SplitList(List=n_floors, Index=lng_2)  # -> ListA, ListB
split_7 = SplitList(List=glass_size, Index=lng_2)  # -> ListA, ListB
fillet = Fillet(Curve=runion, Radius=split_2.ListA)
Z = UnitZ(Factor="0.5")
offset = OffsetCurve(Curve=fillet, Distance=expr("-x", split_3.ListA), Plane=PlaneXY(0, 0, 0), Corners=1)
move = Move(Geometry=offset, Motion=expr("-x", Z))  # -> Geometry, Transform
series = Series(Start=split_4.ListA, Step=split_5.ListA, Count=split_6.ListA)
rulesrf = RuledSurface(CurveA=fillet, CurveB=flatten(move.Geometry))
Z_2 = UnitZ(Factor=series)
cap = CapHoles(Brep=rulesrf)  # -> graft(Brep)
item = ListItem(List=Z_2, Index="-1", Wrap=True)
move_2 = Move(Geometry=move.Geometry, Motion=item)  # -> Geometry, Transform
merge = Merge(Data1=offset, Data2=move_2.Geometry)
offset_l = OffsetCurveLoose(Curve=merge, Distance=expr("-x", "0.05"))
item_2 = ListItem(List=offset_l, Index=0, Wrap=True)  # -> Item, Item1
explode = Explode(Curve=item_2.Item, Recursive=True)  # -> Segments, Vertices
len = Length(Curve=explode.Segments)
division_2 = Division(A=len, B=graft(split_7.ListA))
int = Integer(division_2)
divide = DivideCurve(Curve=explode.Segments, Count=int, Kinks=False)  # -> simplify(Points), Tangents, Parameters
shift = ShiftPaths(Data=divide.Points, Offset=-1)
crv_cp = CurveClosestPoint(Point=shift, Curve=item_2.Item1)  # -> Point, Parameter, Distance
ln = Line(StartPoint=shift, EndPoint=crv_cp.Point)
move_3 = Move(Geometry=graft(fillet), Motion=Z_2)  # -> Geometry, Transform
Z_3 = UnitZ(Factor=1)
pipe = Pipe(Curve=ln, Radius="0.05", Caps=0)  # -> simplify(Pipe)
extr = Extrude(Base=move_3.Geometry, Direction=Z_3)
lng_3 = ListLength(List=extr)
subtraction = Subtraction(A=lng_3, B=1)
move_4 = Move(Geometry=cap, Motion=Z_2)  # -> simplify(Geometry), Transform
shift_2 = ShiftPaths(Data=pipe, Offset=-1)  # -> simplify(Data)
loft = Loft(Curves=offset_l, Options={Adjust=False, Closed=False, LoftEnds=0, LoftSimp=0, LoftType=0, Rebuild=10, Refit=0.01})  # -> simplify(Loft)
split_8 = SplitList(List=extr, Index=subtraction)  # -> ListA, ListB
cap_2 = CapHoles(Brep=split_8.ListB)
merge_2 = Merge(Data1=split_8.ListA, Data2=cap_2)  # -> simplify(Result)
tstat = TreeStatistics(Tree=shift_2)  # -> Paths, Length, Count
tstat_2 = TreeStatistics(Tree=loft)  # -> Paths, Length, Count
tstat_3 = TreeStatistics(Tree=move_4.Geometry)  # -> Paths, Length, Count
tstat_4 = TreeStatistics(Tree=merge_2)  # -> Paths, Length, Count
dpath = DeconstructPath(Branch=tstat.Paths)
dpath_2 = DeconstructPath(Branch=tstat_2.Paths)
dpath_3 = DeconstructPath(Branch=tstat_3.Paths)
dpath_4 = DeconstructPath(Branch=tstat_4.Paths)
item_3 = ListItem(List=dpath_2, Index="-1", Wrap=True)
item_4 = ListItem(List=dpath, Index="-1", Wrap=True)
item_5 = ListItem(List=dpath_3, Index="-1", Wrap=True)
item_6 = ListItem(List=dpath_4, Index="-1", Wrap=True)
dup = DuplicateDataMatch(SourceDataTree="2", SecondaryData1=item_3)  # -> SourceData, SecondaryData1
dup_2 = DuplicateDataMatch(SourceDataTree="3", SecondaryData1=item_4)  # -> SourceData, SecondaryData1
dup_3 = DuplicateDataMatch(SourceDataTree="0", SecondaryData1=item_6)  # -> SourceData, SecondaryData1
dup_4 = DuplicateDataMatch(SourceDataTree="1", SecondaryData1=item_5)  # -> SourceData, SecondaryData1
merge_3 = Merge(Data1=dup.SecondaryData1, Data2=dup.SourceData)
merge_4 = Merge(Data1=dup_2.SecondaryData1, Data2=dup_2.SourceData)
merge_5 = Merge(Data1=dup_3.SecondaryData1, Data2=dup_3.SourceData)
merge_6 = Merge(Data1=dup_4.SecondaryData1, Data2=dup_4.SourceData)
path = ConstructPath(Indices=merge_3)  # -> flatten(Branch)
path_2 = ConstructPath(Indices=merge_4)  # -> flatten(Branch)
path_3 = ConstructPath(Indices=merge_5)  # -> flatten(Branch)
path_4 = ConstructPath(Indices=merge_6)  # -> flatten(Branch)
replace = ReplacePaths(Data=loft, Search=tstat_2.Paths, Replace=path)
replace_2 = ReplacePaths(Data=shift_2, Search=tstat.Paths, Replace=path_2)
replace_3 = ReplacePaths(Data=merge_2, Search=tstat_4.Paths, Replace=path_3)
replace_4 = ReplacePaths(Data=move_4.Geometry, Search=tstat_3.Paths, Replace=path_4)
merge_7 = Merge(Data1=replace_3, Data2=replace_4, Data3=replace, Data4=replace_2)
brep = Brep(merge_7)
context_bake = ContextBake(Geometry=brep)
